# Grasshopper definition starling_egg.gh (Grasshopper 1.0.7)

# ---- group: Document
panel = Panel("""Lars van Vianen
Sander Boer""")
company_text = Text("Starling Associates")
path = FilePath()
authors_text = Text(panel)
description_text = Text("Starling Egg Template")
parameters_text = Text("Starling Egg Template")

# ----
pipeline = GeometryPipeline(
    GroupByLayer=False,
    GroupByType=False,
    IncludeHidden=True,
    IncludeLocked=True,
    LayerFilter="gh::center",
    NameFilter="*",
    SublayerFiltering=True,
    TypeFilter=1)
pt = Point(pipeline)

l_num = Number(Slider(6, range=0..10))
b_num = Number(Slider(4, range=0..10))
n_num = Number(Slider(1.5, range=0..10))
int = Integer(Slider(100, range=0..100))

shell_colour_col = Colour(ColourSwatch(SwatchColor=RGB(121, 212, 242)))
shell_colour_col_2 = Colour(ColourSwatch(SwatchColor=RGB(255, 255, 255)))
crack_n_int = Integer(Slider(16, range=0..100))
shell_shine_num = Number(Slider(0.5, range=0..1))
shell_shine_num_2 = Number(Slider(0, range=0..1))
crack_s_int = Integer(Slider(10, range=0..10))

# ---- group: Version
calendar = Calendar()
version = ControlKnob(Decimals=2, Limit=True, Maximum=10, Minimum=0, Range=1, Value=1)
version_num = Number(version)
date_time = Time(calendar)

# ---- group: Center Planes
pt_2 = Point(pt)  # disabled
xy = XYPlane(Origin=pt_2)  # disabled
xz = XZPlane(Origin=pt_2)  # disabled
yz = YZPlane(Origin=pt_2)  # disabled
pln = Plane(xy)  # disabled
pln_2 = Plane(xz)  # disabled
pln_3 = Plane(yz)  # disabled

# ----
l_num_2 = Number(l_num)
b_num_2 = Number(b_num)
n_num_2 = Number(n_num)
expression = Expression(L=l_num_2, B=b_num_2, n=n_num_2, Expression="(L - B) / (2 * n)")
w_num = Number(expression)

# ---- group: Legend
input = ColourSwatch(SwatchColor=RGB(255, 254, 254))
input_2 = ColourSwatch(SwatchColor=RGB(255, 254, 254))
input_3 = ColourSwatch(SwatchColor=RGB(255, 254, 254))
input_4 = ColourSwatch(SwatchColor=RGB(255, 254, 254))

# ----
num = Number(Slider(0.2, range=0..1))
int_2 = Integer(Slider(25, range=0..100))
int_3 = Integer(int_2)
reldif = RelativeDifferences()
int_4 = Integer(int_2)
Z = UnitZ(Factor=1)
rev = Reverse(Vector=Z)
replace = ReplaceItems(Wrap=False)

l_num_3 = Number(l_num)
int_5 = Integer(int)
expression_2 = Expression(L=l_num_3, Expression="(L / 2)")

expression_3 = Expression(L=l_num_3, Expression="-(L / 2)")

dom = ConstructDomain(DomainStart=expression_3, DomainEnd=expression_2)
range = Range(Domain=dom, Steps=int_5)
x_num = Number(range)

num_2 = Number(expression_3)
num_3 = Number(expression_2)

# ---- group: Eq. (1). Hügelschäffer's Model
b_num_3 = Number(b_num)
w_num_2 = Number(w_num)
l_num_4 = Number(l_num)
x_num_2 = Number(x_num)
reference = Panel("https://geometrymatters.com/the-shape-of-a-perfect-egg-defined-by-a-universal-formula/")
# maximum egg breadth (B) to
# 
# egg length (L)
# 
# n is a positive number.
hügelschäffer_s_model = Expression(L=l_num_4, B=b_num_3, w=w_num_2, x=x_num_2, Expression="(B/2) * (SQRT((L² - 4*x²) / (L² + 8*w*x + 4*w²)))")
y_num = Number(hügelschäffer_s_model)

# ---- group: Shell
y_num_2 = Number(y_num)
x_num_3 = Number(x_num)
pt_3 = ConstructPoint(XCoordinate=0, YCoordinate=y_num_2, ZCoordinate=x_num_3)
pt_4 = ConstructPoint(XCoordinate=0, YCoordinate=0, ZCoordinate=0)
Z_2 = UnitZ(Factor=1)
intcrv = Interpolate(Vertices=pt_3, Degree=3, Periodic=False, KnotStyle=1)  # -> Curve, Length, Domain
line = LineSDL(Start=pt_4, Direction=Z_2, Length=1)
revsrf = Revolution(Curve=intcrv.Curve, Axis=line, Domain=Domain(0, 6.283185307))
shell_srf = Surface(revsrf)

# ---- group: Cracks
xy_2 = XYPlane(Origin=Point(0, 0, 0))
shell_srf_2 = Surface(shell_srf)
crack_n_int_2 = Integer(crack_n_int)
crack_s_int_2 = Integer(crack_s_int)
reference_2 = Panel("https://www.grasshopper3d.com/forum/topics/voronoi-on-multi-curved-surface")
popgeo = PopulateGeometry(Geometry=shell_srf_2, Count=crack_n_int_2, Seed=crack_s_int_2)
bbox = BoundingBox(Content=shell_srf_2, Plane=xy_2)  # -> Box, Box_2
voronoi³ = Voronoi3D(Points=popgeo, Box=bbox.Box)  # -> Cells, Boundary
bbx = BrepBrep(BrepA=shell_srf_2, BrepB=voronoi³.Cells)  # -> simplify(Curves), Points
cracks_crv = Curve(bbx.Curves)
pt_5 = Point(popgeo)

# ----
pt_6 = Point(pt_5)

cracks_crv_2 = Curve(cracks_crv)
shell_srf_3 = Surface(shell_srf)
pdecon = Deconstruct(Point=pt_6)  # -> XComponent, YComponent, ZComponent
pt_7 = ConstructPoint(XCoordinate=pdecon.XComponent, YCoordinate=pdecon.YComponent, ZCoordinate=0)
vec = VectorXYZ(XComponent=pdecon.XComponent, YComponent=pdecon.YComponent, ZComponent=0)  # -> Vector, Length
rev_2 = Reverse(Vector=vec.Vector)
rotate = RotateDirection(Geometry=shell_srf_3, Center=Point(0, 0, 0), From=Vector(1, 0, 0), To=rev_2)  # -> Geometry, Transform
srfsplit = SurfaceSplit(Surface=graft(rotate.Geometry), Curves=cracks_crv_2)  # -> simplify(Fragments)
area = Area(Geometry=srfsplit)  # -> Area, Centroid
sort = SortList(Keys=area.Area, ValuesA=srfsplit)  # -> Keys, ValuesA
item = ListItem(List=sort.ValuesA, Index=0, Wrap=True)
srf = Surface(item)

pt_8 = ConstructPoint(XCoordinate=0, YCoordinate=0, ZCoordinate=0)
srf_2 = Surface(srf)
num_4 = Number(num)
pt_9 = Point(pt_5)
vec2pt = Vector2Pt(PointA=pt_8, PointB=pt_9, Unitize=False)  # -> Vector, Length
amp = Amplitude(Vector=vec2pt.Vector, Amplitude=num_4)
move = Move(Geometry=flatten(srf_2), Motion=amp)  # -> simplify(Geometry), Transform
rulesrf = RuledSurface(CurveA=flatten(srf_2), CurveB=move.Geometry)
merge = Merge(Data1=simplify(srf_2), Data2=simplify(graft(rulesrf)), Data3=simplify(graft(move.Geometry)))
join = BrepJoin(Breps=merge)  # -> Breps, Closed
brep = Brep(join.Breps)

area_2 = Area(Geometry=move.Geometry)  # -> Area, Centroid
srf_cp = SurfaceClosestPoint(Point=area_2.Centroid, Surface=move.Geometry)  # -> Point, UVPoint, Distance
evalsrf = EvaluateSurface(Surface=move.Geometry, Point=srf_cp.UVPoint)  # -> Point, Normal, UDirection, VDirection, Frame
srf_3 = Surface(move.Geometry)
vec_2 = Vector(evalsrf.Normal)
brep_2 = Brep(brep)
vec_3 = Vector(vec_2)
pt_10 = Point(pt_5)
num_5 = Number(num_2)
cracks_crv_3 = Curve(cracks_crv)
item_2 = ListItem(List=flatten(vec_3), Index=int_3, Wrap=True)
item_3 = ListItem(List=flatten(brep_2), Index=int_3, Wrap=True)
item_4 = ListItem(List=flatten(pt_10), Index=int_3, Wrap=True)
item_5 = ListItem(List=flatten(num_5), Index=int_3, Wrap=True)
cull_i = CullIndex(List=flatten(brep_2), Indices=int_3, Wrap=True)
devec = DeconstructVector(Vector=item_2)  # -> XComponent, YComponent, ZComponent
pt_11 = ConstructPoint(XCoordinate=0, YCoordinate=0, ZCoordinate=item_5)
pdecon_2 = Deconstruct(Point=item_4)  # -> XComponent, YComponent, ZComponent
vec_4 = VectorXYZ(XComponent=devec.XComponent, YComponent=devec.YComponent, ZComponent=0)  # -> Vector, Length
brep_3 = Brep(cull_i)
subtraction = Subtraction(A=item_5, B=pdecon_2.ZComponent)
brep_4 = Brep(brep_3)

crack_shine_num = Number(shell_shine_num_2)
crack_colour_col = Colour(shell_colour_col_2)
material = CreateMaterial(Diffuse=crack_colour_col, Specular=RGB(255, 254, 254), Emission=RGB(0, 0, 0), Transparency=0, Shine=crack_shine_num)
preview = CustomPreview(Geometry=cracks_crv_3, Material=material)

amp_2 = Amplitude(Vector=vec_4.Vector, Amplitude=subtraction)
pl = PlaneNormal(Origin=item_4, ZAxis=item_2)
rev_3 = Reverse(Vector=amp_2)
brep_5 = Brep(brep)
move_2 = Move(Geometry=pt_11, Motion=rev_3)  # -> Geometry, Transform
deplane = DeconstructPlane(Plane=pl)  # -> Origin, XAxis, YAxis, ZAxis
pl_2 = ConstructPlane(Origin=move_2.Geometry, XAxis=deplane.XAxis, YAxis=deplane.YAxis)
padjust = AdjustPlane(Plane=pl_2, Normal=rev)
orient = Orient(Geometry=item_3, Source=pl, Target=padjust)  # -> Geometry, Transform
brep_6 = Brep(orient.Geometry)
brep_7 = Brep(brep_6)

shell_shine_num_3 = Number(shell_shine_num)
shell_srf_4 = Surface(brep_4)
shell_colour_col_3 = Colour(shell_colour_col)
material_2 = CreateMaterial(Diffuse=shell_colour_col_3, Specular=RGB(255, 254, 254), Emission=RGB(0, 0, 0), Transparency=0, Shine=shell_shine_num_3)
preview_2 = CustomPreview(Geometry=[brep_4, brep_7], Material=material_2)
